# Grasshopper definition ShadingCanopyLouvers-v2.gh (Grasshopper 1.0.7)
# plug-ins: Human, Kangaroo2 Components, Weaverbird, MeshEdit Components

# ---- group: louvers
angle = Slider(60, range=-60..60)
depth = Slider(200, range=100..200)
# DIFFERENTIAL
# Grid Shell Form Finding
# Grasshopper script that uses Ladybug to analyze the direct sunlight impact on a canopy with adjustable louvers.
# The script allows users to generate canopy louvers, adjust their density, rotation, and angle, and directly observe
# the effect on shading below the canopy. Users can also customize the location and specific day of the year
# for accurate sunlight analysis. The Human plugin is used for enhanced visualization of the canopy and its shading effects.
# 
# Requirements:
# Rhino 6 or later with Grasshopper
# - Ladybug
# - Human
# - Weaverbird
# 
# We welcome contributions to improve the script!
# If you encounter any issues or have suggestions for enhancements, please feel free to reach out to us.
# Contact us at: hello@differential.works.
# 1. Louver Parameters
density = Slider(7, range=1..7)

# ---- group: structure
profile_offset = Slider(100, range=0..100)
profile_depth = Slider(300, range=0..1000)

# ----
canopy_mesh = Mesh(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)
grid_base = Mesh(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)

div = DivideDomain(Domain=Domain(0, 1), Count=density)
dedomain = DeconstructDomain(Domain=div)  # -> Start, End
cull_i = CullIndex(List=dedomain.Start, Indices=0, Wrap=True)

# ----
# 2. Louver Generation
mesh = Mesh(canopy_mesh)
turn = MeshTurn(Mesh=mesh)
md = MeshDirection(Mesh=turn)
faceb = FaceBoundaries(Mesh=md)
explode = Explode(Curve=faceb, Recursive=True)  # -> Segments, Vertices
item = ListItem(List=explode.Segments, Index=0, Wrap=True)  # -> Item, Item1, Item2
flip = FlipCurve(Curve=item.Item2)  # -> Curve, Flag
tweencrv = TweenCurve(CurveA=item.Item, CurveB=flip.Curve, Factor=cull_i, BlendType=0)
facen = FaceNormals(Mesh=md)  # -> Centers, Normals
amp = Amplitude(Vector=facen.Normals, Amplitude=depth)
rad = Radians(Degrees=angle)
extr = Extrude(Base=tweencrv, Direction=graft(amp))
rotax = RotateAxis(Geometry=extr, Angle=rad, Axis=tweencrv)  # -> Geometry, Transform

wbframe = WeaverbirdsPictureFrame(MeshPolylines=mesh, Distance=profile_offset, InsetType=1)
wbthicken = WeaverbirdsMeshThicken(MeshCurves=wbframe, Distance=profile_depth, OffsetType=0)

# ---- group: location
number_slider = Slider(55.18, range=0..100)
number_slider_2 = Slider(25.07, range=0..100)
# 3. Location & Date
panel = Panel("Dubai, UAE")
constrloc = LBConstructLocation(latitude=number_slider_2, longitude=number_slider, elevation=0)  # -> location; plug-in component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

# ---- group: date
series = Series(Start=0, Step=1, Count=24)
hoy = LBCalculateHOY(month=Slider(12, range=1..12), day="21", hour=series)  # -> flatten(hoy), flatten(doy), flatten(date); plug-in component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

# ---- group: legend
legend_segments = Slider(7, range=0..10)
legend_min = Slider(0, range=0..100)
legend_max = Slider(12, range=0..100)

# ----
dom = ConstructDomain(DomainStart=legend_min, DomainEnd=legend_max)
div_2 = DivideDomain(Domain=dom, Count=legend_segments)
dedomain_2 = DeconstructDomain(Domain=div_2)  # -> Start, End

gradient = Gradient(
    LowerLimit=legend_min,
    UpperLimit=legend_max,
    Parameter=dedomain_2.Start,
    stops=[0: RGB(0, 0, 192), 0.261: RGB(51, 153, 255), 0.5: RGB(254, 244, 84), 0.728: RGB(234, 126, 0), 1: RGB(234, 38, 0)])

wbsplitquads = WeaverbirdsConstantQuadsSplitSubdivision(MeshCurves=grid_base, Level=3, SmoothNakedEdges=0)
flip_2 = MeshFlip(Mesh=wbsplitquads)

legendpar = LBLegendParameters(min=legend_min, max=legend_max, seg_count=legend_segments, colors=gradient, font="Neue Pixel Grotesk")  # -> leg_par; plug-in component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

# ----
# 4. Sunlight Analysis
sunpath = LBSunPath(location=constrloc, hoys=hoy.hoy, scale=1)  # -> report, vectors, altitudes, azimuths, hoys, sun_pts, analemma, daily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; plug-in component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
shading = Geometry([rotax.Geometry, wbthicken])
directsunhours = LBDirectSunHours(
    vectors=flatten(sunpath.vectors),
    geometry=flatten(flip_2),
    context=flatten(shading),
    grid_size=Slider(0.2, range=0..1),
    offset_dist="100",
    legend_par=legendpar,
    run=Toggle(True))  # -> report, points, results, mesh, legend, title, int_mtx; plug-in component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

X = UnitX(Factor=1)
pt = Point(Point(17359.57276, 60651.21672, 0))
line = LineSDL(Start=pt, Direction=X, Length=Slider(3000, range=0..10000))
Y = UnitY(Factor=profile_depth)
move = Move(Geometry=line, Motion=Y)  # -> Geometry, Transform
divide = DivideCurve(Curve=line, Count=density, Kinks=False)  # -> Points, Tangents, Parameters
pull = PullPoint(Point=divide.Points, Geometry=move.Geometry, ClosestOnly=True)  # -> ClosestPoint, Distance
ln = Line(StartPoint=pull.ClosestPoint, EndPoint=divide.Points)
cull_i_2 = CullIndex(List=pull.ClosestPoint, Indices=0, Wrap=True)  # -> reverse(List)
cull_i_3 = CullIndex(List=ln, Indices=0, Wrap=True)  # -> reverse(List)
rad_2 = Radians(Degrees=angle)
cull_i_4 = CullIndex(List=cull_i_2, Indices=0, Wrap=True)  # -> reverse(List)
cull_i_5 = CullIndex(List=cull_i_3, Indices=0, Wrap=True)  # -> reverse(List)
curvepoint = PointOnCurve(cull_i_5, parameter=0.5)
number_slider_3 = Slider(25, range=0..100)
rotate = Rotate(Geometry=cull_i_5, Angle=rad_2, Plane=curvepoint)  # -> Geometry, Transform
line_2 = LineSDL(Start=curvepoint, Direction=rotate.Geometry, Length=depth)
amp_2 = Amplitude(Vector=rotate.Geometry, Amplitude=depth)
move_2 = Move(Geometry=line_2, Motion=expr("x/-2", amp_2))  # -> Geometry, Transform
offset = OffsetCurve(Curve=move_2.Geometry, Distance=expr("x*-1", number_slider_3), Corners=1)
offset_2 = OffsetCurve(Curve=move_2.Geometry, Distance=number_slider_3, Corners=1)
scale = Scale(Geometry=rotate.Geometry, Center=curvepoint, Factor=3)  # -> Geometry, Transform
loft = Loft(
    Curves=[move.Geometry, line],
    Options={Adjust=False, Closed=False, LoftEnds=0, LoftSimp=0, LoftType=0, Rebuild=10, Refit=0.01})
loft_2 = Loft(
    Curves=[offset_2, offset],
    Options={Adjust=False, Closed=False, LoftEnds=0, LoftSimp=0, LoftType=0, Rebuild=10, Refit=0.01})
offset_3 = OffsetCurve(Curve=offset, Distance=expr("x*-1", Slider(100, range=0..100)), Corners=1)
divide_2 = DivideCurve(Curve=scale.Geometry, Count=15, Kinks=False)  # -> Points, Tangents, Parameters
edges = BrepEdges(Brep=loft)  # -> Naked, Interior, NonManifold
curvepoint_2 = PointOnCurve(scale.Geometry, parameter=0.881)
edges_2 = BrepEdges(Brep=loft_2)  # -> Naked, Interior, NonManifold
number_slider_4 = Slider(35, range=0..100)
Y_2 = UnitY(Factor=150)
end = EndPoints(Curve=scale.Geometry)  # -> Start, End
shatter = Shatter(Curve=graft(scale.Geometry), Parameters=divide_2.Parameters)
move_3 = Move(Geometry=end.End, Motion=Y_2)  # -> Geometry, Transform
cull = CullPattern(List=shatter, CullPattern=[False, True, True])
angledim = AngularDimension(Center=end.End, PointA=move_3.Geometry, PointB=curvepoint_2, Reflex=False, Text="{0:0.0}°", Size=number_slider_4)
preview = CustomPreview(Geometry=loft, Material=ColourSwatch(SwatchColor=RGB(230, 230, 230)))
previewlw = CustomPreviewLineweights(Geometry=cull, Shader=ColourSwatch(SwatchColor=RGB(0, 0, 0)), Absolute=False)
preview_2 = CustomPreview(Geometry=loft_2, Material=ColourSwatch(SwatchColor=RGB(201, 201, 201)))
linedim = LineDimension(Line=offset_3, Text="{0:0}", Size=number_slider_4)
previewlw_2 = CustomPreviewLineweights(Geometry=[edges.Naked, edges.Interior, edges.NonManifold], Shader=ColourSwatch(SwatchColor=RGB(0, 0, 0)), Absolute=False)
previewlw_3 = CustomPreviewLineweights(
    Geometry=[edges_2.Naked, edges_2.Interior, edges_2.NonManifold],
    Shader=ColourSwatch(SwatchColor=RGB(0, 0, 0)),
    Absolute=False)

# ---- group: rounding values
avr = Average(Input=directsunhours.results)  # -> flatten(ArithmeticMean)
pow = Power(A="10", B=Slider(2, range=0..10))
multiplication = Multiplication(A=avr, B=pow)
round = Round(Number=multiplication)  # -> Nearest, Floor, Ceiling
division = Division(A=round.Nearest, B=pow)

# ----
facen_2 = FaceNormals(Mesh=canopy_mesh)  # -> Centers, Normals
mesh_2 = Mesh(grid_base)
pdecon = Deconstruct(Point=facen_2.Centers)  # -> XComponent, YComponent, ZComponent
sort = SortList(Keys=flatten(pdecon.ZComponent), ValuesA=flatten(facen_2.Centers))  # -> reverse(Keys), reverse(ValuesA)
medges = MeshEdges(Mesh=mesh_2)  # -> NakedEdges, InteriorEdges, NonManifoldEdges
item_2 = ListItem(List=sort.Keys, Index=0, Wrap=True)
item_3 = ListItem(List=sort.ValuesA, Index=0, Wrap=True)

item_4 = ListItem(List=hoy.date, Index=0, Wrap=True)
fragment = TextFragment(Text=item_4, Start=Slider(0, range=0..10), Count=Slider(6, range=0..10))
pt_2 = Point(Point(2281.151785, -16900.09714, 28188.57137))

join = TextJoin(Text=flatten([division, " hours"]))
join_2 = TextJoin(Text=flatten(["average ", join]))
number_slider_5 = Slider(30, range=0..100)
pt_3 = Point(Point(1601.152077, -15408.57541, 1658.922484))
screentext = ScreenOrientedText(
    Text=join_2,
    Font="Neue Pixel Grotesk",
    Justification=7,
    Location=pt_3,
    SizeFactor=number_slider_5,
    Depth=0,
    Absolute=False)

# ----
# 5. Visualization
number_slider_6 = Slider(20, range=0..100)
preview_analysis_mesh = Geometry(directsunhours.mesh)
pt_4 = Point(Point(4238.706488, -21091.36508, 799.1525588))
pt_5 = Point(Point(4708.22239, -22090.12405, 2830.014148))
pt_6 = Point(Point(2312.868074, -16900.09714, 31084.51299))
pt_7 = Point(Point(2262.986368, -16900.09714, 29613.08177))
pt_8 = Point(Point(2329.064208, -16900.09714, 32768.11136))

round_2 = Round(Number=item_2)  # -> Nearest, Floor, Ceiling
join_3 = TextJoin(Text=flatten([angle, "°"]))
join_4 = TextJoin(Text=flatten(["louver angle: ", join_3]))
screentext_2 = ScreenOrientedText(
    Text=join_4,
    Font="Neue Pixel Grotesk",
    Justification=7,
    Location=pt_5,
    SizeFactor=number_slider_6,
    Depth=0,
    Absolute=False)

join_5 = TextJoin(Text=flatten([depth, "mm"]))
join_6 = TextJoin(Text=flatten(["louver depth: ", join_5]))
screentext_3 = ScreenOrientedText(
    Text=join_6,
    Font="Neue Pixel Grotesk",
    Justification=7,
    Location=pt_4,
    SizeFactor=number_slider_6,
    Depth=0,
    Absolute=False)

num = Number(expr("x-1", density))
join_7 = TextJoin(Text=flatten(["louver density: ", num]))
pt_9 = Point(Point(2677.017195, -17730.87308, 1377.961235))
screentext_4 = ScreenOrientedText(
    Text=join_7,
    Font="Neue Pixel Grotesk",
    Justification=7,
    Location=pt_9,
    SizeFactor=number_slider_6,
    Depth=0,
    Absolute=False)

join_8 = TextJoin(Text=flatten(["latitude: ", number_slider_2]))
screentext_5 = ScreenOrientedText(
    Text=join_8,
    Font="Neue Pixel Grotesk",
    Justification=7,
    Location=pt_6,
    SizeFactor=number_slider_6,
    Depth=0,
    Absolute=False)

join_9 = TextJoin(Text=flatten(["longitude: ", number_slider]))
screentext_6 = ScreenOrientedText(
    Text=join_9,
    Font="Neue Pixel Grotesk",
    Justification=7,
    Location=pt_7,
    SizeFactor=number_slider_6,
    Depth=0,
    Absolute=False)

join_10 = TextJoin(Text=flatten(["location: ", panel]))
screentext_7 = ScreenOrientedText(
    Text=join_10,
    Font="Neue Pixel Grotesk",
    Justification=7,
    Location=pt_8,
    SizeFactor=number_slider_5,
    Depth=0,
    Absolute=False)

join_11 = TextJoin(Text=flatten(["date: ", fragment]))
screentext_8 = ScreenOrientedText(
    Text=join_11,
    Font="Neue Pixel Grotesk",
    Justification=7,
    Location=pt_2,
    SizeFactor=number_slider_6,
    Depth=0,
    Absolute=False)

curvepoint_3 = PointOnCurve(medges.InteriorEdges, parameter=0.5)
swatch = ColourSwatch(SwatchColor=RGB(0, 0, 0))
scale_2 = Scale(Geometry=medges.InteriorEdges, Center=curvepoint_3, Factor=0.8)  # -> Geometry, Transform

Z = UnitZ(Factor=item_2)
move_4 = Move(Geometry=medges.NakedEdges, Motion=Z)  # -> Geometry, Transform
join_12 = JoinCurves(Curves=move_4.Geometry, Preserve=False)
simplify = SimplifyCurve(Curve=join_12)  # -> Curve, Simplified
explode_2 = Explode(Curve=simplify.Curve, Recursive=True)  # -> Segments, Vertices
Z_2 = UnitZ(Factor=-1)
line_3 = LineSDL(Start=explode_2.Vertices, Direction=Z_2, Length=item_2)

preview_3 = CustomPreview(Geometry=wbthicken, Material=ColourSwatch(SwatchColor=RGB(92, 92, 92)))
preview_4 = CustomPreview(Geometry=rotax.Geometry, Material=ColourSwatch(SwatchColor=RGB(153, 153, 153)))

previewlw_4 = CustomPreviewLineweights(Geometry=medges.NakedEdges, Shader=swatch, Thickness=Slider(3, range=0..10), Absolute=False)
previewlw_5 = CustomPreviewLineweights(Geometry=[scale_2.Geometry, move_4.Geometry, line_3], Shader=swatch, Thickness=Slider(1, range=0..10), Absolute=False)
